% Simulink data dictionary DD_CtrlBaseline.sldd

CertificationSettings = struct(
  Wind=struct(
    Type=2,
    T=400,
    Ly=126,
    Lz=126,
    dt=0.1,
    Ny=20,
    Nz=20,
    Class=[1; 2],
    Step=5,
    EWS=60,
    EOG=60,
    EDC=60,
    ECG=60,
    StepDuration=20),
  Mode=struct(Type=1, Actiontime=30),
  Run=struct(WindSpeed=24, Seeds=1, Time=400, SeedNumber=1, RandomSeed=true))

Drivetrain = struct(Generator=struct(Efficiency=0.944, HSSInertia=534.116), Gearbox=struct(Ratio=97, Efficiency=1))
P_InitAngle = 0.106

slBus2 = Simulink.Bus()
  RefBlPitch1: double
  RefBlPitch2: double
  RefBlPitch3: double
  RefGenTq: double

slBus1 = Simulink.Bus()
  wind_mpers: double
  GenSpd_radpers: double
  RotSpd_radpers: double
  ydotdot_mpers2: double
  xdotdot_mpers2: double
  zetadotdot_mpers2: double
  ThetaS_rad: double
  GenPwr_kW: double
  GenTq_Nm: double
  Pitch_rad: double

Control = struct(
  ForeAft=struct(Gain=0, MaxPitchAmplitude=5),
  Pitch=struct(
    Fine=0.106,
    Min=-2,
    Max=90,
    Minrate=-13,
    Maxrate=13,
    Kp=-0.003,
    Scheduled=1,
    ScheduledPitchAngles=[0.0706; 0.1168; 0.1524; 0.183; 0.2116; 0.2385; 0.263; 0.286; 0.308; 0.3284; 0.3488; 0.3691; 0.3895; 0.4083],
    KpGS=[-0.0164; -0.0107; -0.0083; -0.0068; -0.0057; -0.0049; -0.0043; -0.0037; -0.0033; -0.0028; -0.0026; -0.0023; -0.002; -0.0017],
    KiGS=[-0.0027; -0.0027; -0.0026; -0.0025; -0.0024; -0.0024; -0.0024; -0.0023; -0.0023; -0.0023; -0.0023; -0.0023; -0.0023; -0.0023],
    Ki=-0.001,
    StartupPitch=45,
    StartupPitchRate=1,
    StartupSpeed=0.25,
    Notch_beta1=0,
    Notch_beta2=0,
    Notch_wn=0,
    Notch_beta1GS=repmat(0, 14, 1),
    Notch_beta2GS=repmat(0, 14, 1),
    Notch_wnGS=repmat(0, 14, 1),
    LowPassCutOffFreq=3,
    LowPassCutOffFreqGS=repmat(3, 14, 1),
    LowPassOrder=1,
    Notch2_beta1GS=repmat(0, 14, 1),
    Notch2_beta2GS=repmat(0, 14, 1),
    Notch2_wnGS=repmat(0, 14, 1),
    Notch2_beta1=0,
    Notch2_beta2=0,
    Notch2_wn=0),
  Torque=struct(
    Demanded=43529,
    Limit=47403,
    Slewrate=20000,
    OptGain=2.3323,
    SpeedA=670,
    SpeedB=871,
    SpeedC=1162,
    SpeedB2=1136,
    Min=200,
    LowPassCutOffFreq=3),
  Brake=struct(Deploytime=0.6, Torque=28116, Delay=1.5),
  WindSpeed=struct(Cutin=4, Cutout=25),
  DT=0.008)