% Simulink data dictionary DD_LPV.sldd

Ng = 97
DT = 0.008
OutList = {"Time", "Wind1VelX", "Wind1VelY", "Wind1VelZ", "OoPDefl1", "OoPDefl2", "OoPDefl3", "IPDefl1", "IPDefl2", "IPDefl3", "NcIMUTAxs", "NcIMUTAys", "NcIMUTAzs", "RootMOoP1", "RootMOoP2", "RootMOoP3", "RootMIP1", "RootMIP2", "RootMIP3", "RootMFlp1", "RootMFlp2", "RootMFlp3", "RootMEdg1", "RootMEdg2", "RootMEdg3", "TwrBsMxt", "TwrBsMyt", "TwrBsMzt", "LSSTipMya", "LSSTipMza", "LSSTipVxa", "GenSpeed", "BlPitch1", "Azimuth", "RotPwr", "RotThrust", "RotSpeed", "HSShftTq", "GenPwr", "GenTq"}

sysd = ss(
  a=[0.9998562 -2.484399e-09 0.006611801 -3.626123e-08 -8.683253e-09 -0.0002864058 2.28344e-06 2.405248e-06 2.139457e-06 2.65228e-07 1.754282e-06 1.944371e-06 -7.140677e-05 -7.354734e-05 -6.82402e-05 0.00799895 -4.121394e-08 2.401573e-05 -6.059846e-07 -2.140562e-06 -4.955615e-06 -1.280242e-08 -9.967758e-09 -1.578426e-08 1.049914e-08 -1.022442e-08 2.619949e-08 -3.294179e-07 -3.603843e-07 -3.189407e-07
   -1.279812e-08 0.9998621 -8.720932e-05 0.00703363 -7.312851e-06 -2.75192e-05 -1.18836e-07 4.587075e-07 -3.60611e-07 2.641275e-06 -9.641392e-06 7.389596e-06 6.14371e-06 -1.190456e-05 5.533861e-06 -2.3912e-08 0.007999125 -6.439431e-07 2.573349e-05 -2.423792e-08 -2.251938e-07 -2.81608e-08 1.830453e-08 7.007425e-09 2.175533e-07 -9.609304e-08 -1.203457e-07 1.088232e-07 -5.682236e-08 -5.641363e-08
   8.11611e-06 -1.235223e-07 0.9901293 -9.830554e-06 -3.176002e-07 -2.586316e-05 -4.547135e-07 3.109047e-06 -1.951282e-06 -2.61388e-06 3.467633e-06 -4.892075e-07 3.404865e-06 -5.188457e-05 2.746501e-05 2.93853e-08 -4.779981e-09 0.007963841 -1.474199e-07 -2.154038e-07 -4.667975e-07 -6.202702e-10 7.743934e-09 -1.055238e-08 -3.847621e-10 -1.997115e-08 2.299446e-08 1.870301e-08 -2.401185e-07 1.207835e-07
   -2.605473e-09 8.629824e-06 -1.008684e-05 0.9892939 -1.017814e-06 0.001957483 -2.921578e-07 1.359745e-07 1.613958e-07 2.951709e-08 -1.266908e-06 1.122737e-06 5.042378e-06 -2.71802e-06 -2.462162e-06 1.394087e-09 4.56925e-08 -1.06686e-08 0.007960816 6.577567e-08 1.92676e-05 -4.121297e-09 2.660812e-09 1.260664e-09 2.694398e-08 -1.244458e-08 -1.491041e-08 3.202836e-08 -1.226871e-08 -2.06305e-08
   -2.576723e-09 3.563052e-09 -1.124727e-07 4.21046e-05 1 0.005465537 8.728609e-09 6.895015e-09 6.883104e-09 -1.531214e-07 -1.437628e-07 -1.590362e-07 -1.273984e-07 -9.199246e-08 -9.567593e-08 -6.324481e-10 7.285533e-11 -1.516785e-09 1.452006e-07 0.00798702 5.374566e-05 1.532127e-10 9.853806e-11 1.226746e-10 -6.761142e-10 -4.376654e-10 -4.170144e-10 -3.045768e-10 -1.156552e-10 -5.888804e-11
   -6.105653e-07 2.548062e-07 -3.772198e-05 0.002860635 4.6549e-07 0.9885251 1.85421e-06 1.745511e-06 1.721111e-06 -3.603854e-05 -3.53125e-05 -3.645198e-05 -2.631369e-05 -2.419047e-05 -2.405452e-05 -1.506012e-07 7.349246e-09 -4.260707e-07 1.053316e-05 1.306166e-05 0.007887255 3.33358e-08 2.726778e-08 3.142893e-08 -1.58117e-07 -1.434897e-07 -1.423494e-07 -6.451499e-08 -5.689013e-08 -4.916161e-08
   0.0001901525 -1.658646e-05 -0.03735691 -0.02075374 -5.268576e-05 0.0909659 0.9993289 -2.080032e-05 -3.610774e-05 0.0007509665 0.0005749073 0.0005744836 -0.005465511 0.000306395 0.0005472696 -0.0001398885 -9.388522e-06 -0.000442985 0.0002965581 0.0008717938 0.001766491 0.007906223 -8.488451e-07 1.726837e-08 -2.741337e-05 6.322032e-06 -1.709106e-06 -3.940848e-05 1.659759e-06 5.719408e-07
   0.0002340882 4.553916e-05 0.2180684 0.009556688 0.000118342 0.08589929 -2.333374e-05 0.9992642 1.265608e-05 0.0006332954 0.0006712115 0.0005734511 0.0005108713 -0.004078998 -6.82e-05 -0.0002695353 3.040256e-05 -0.001306749 0.0001818689 0.0007531607 0.001595994 -3.377758e-07 0.007901763 -1.129778e-06 -2.171004e-06 -2.597317e-05 5.987186e-06 2.503984e-07 -3.255808e-05 1.596481e-07
   0.0001709672 -3.070336e-05 -0.1415955 0.01160805 -7.379779e-05 0.08408067 -3.481424e-05 1.534141e-05 0.999297 0.0005336828 0.0006189389 0.0007493948 0.0004552217 -0.0003214217 -0.005164265 -6.444863e-06 2.760824e-05 0.001190697 0.000223608 0.0008498218 0.001676633 -8.091754e-07 3.906569e-07 0.00790434 6.635847e-06 -2.153791e-06 -2.724727e-05 2.326077e-06 -3.404561e-06 -3.80697e-05
   2.014848e-06 7.318442e-05 -0.049111 0.0005998537 0.0001737123 -0.4717032 0.0001818079 0.000169001 0.0001435873 0.9953601 -0.003088337 -0.003127503 -0.0004411026 -0.00240415 -0.002006584 -1.772415e-05 5.532859e-06 -0.000401687 4.606398e-05 0.0001679867 -0.004468697 1.226824e-05 2.524604e-06 2.669101e-06 0.007981024 -1.329556e-05 -1.236331e-05 4.547348e-06 -6.437068e-06 -4.144144e-06
   5.569629e-05 -0.0002701563 0.06618841 -0.02440514 -0.0006383157 -0.464124 0.0001531155 0.0001591213 0.0001652743 -0.003094492 0.9953404 -0.003099517 -0.002061584 -4.003677e-05 -0.002270721 6.461153e-06 3.116862e-06 0.0003996599 -4.693454e-05 0.0001680914 -0.004387199 2.682163e-06 1.093858e-05 2.953558e-06 -1.183046e-05 0.007980734 -1.371347e-05 -3.972448e-06 6.638302e-06 -5.711038e-06
   5.183945e-05 0.0002045417 -0.01032516 0.02134869 0.0004830588 -0.4761335 0.0001529345 0.0001534025 0.0001812612 -0.003125532 -0.003091106 0.9953507 -0.002125282 -0.002119021 -0.0003963972 -2.827279e-06 1.540589e-06 -3.281871e-05 0.0001429818 0.0001763546 -0.004509017 2.835086e-06 2.370448e-06 1.203962e-05 -1.348257e-05 -1.235494e-05 0.007981121 -4.766822e-06 -4.917355e-06 5.093789e-06
   -0.0002198328 1.981264e-05 0.006862799 0.01066476 4.441635e-05 -0.03776984 -8.249113e-05 1.557371e-05 1.393884e-05 -4.22494e-05 -0.0002257071 -0.0002332824 0.990034 -0.0002759425 -0.0002501696 3.573673e-05 -4.106781e-06 0.0003770941 4.655675e-05 6.446779e-05 -0.0003072967 -1.738496e-05 1.166398e-07 2.366006e-07 -4.263313e-06 -5.135638e-07 -1.317549e-06 0.007925266 -8.294195e-07 -8.665725e-07
   -0.0002388881 -3.704291e-05 -0.1099881 -0.005801788 -8.745531e-05 -0.03486435 1.070628e-05 -3.656722e-05 -8.33037e-06 -0.000264845 2.679299e-06 -0.0002321584 -0.0002750292 0.9893483 3.134463e-05 6.594136e-06 6.224451e-06 -0.0005007249 3.102522e-05 7.345063e-05 -0.0002684783 1.651478e-07 -1.756656e-05 -3.842473e-08 -1.222544e-06 -4.394037e-06 -3.003433e-07 -8.949048e-07 0.007919191 5.071096e-07
   -0.0002032641 1.63189e-05 0.05800458 -0.00516828 3.881372e-05 -0.03445838 1.610009e-05 -2.110728e-06 -7.576708e-05 -0.000219633 -0.0002485617 -3.733517e-05 -0.0002504617 3.170504e-05 0.9899176 1.796364e-06 2.320507e-06 4.176683e-05 -1.421331e-05 8.266426e-05 -0.0002566258 1.682334e-07 1.985876e-07 -1.729481e-05 -5.510999e-07 -1.251555e-06 -4.320632e-06 -6.751476e-07 3.888021e-07 0.007922958
   -0.03594228 -5.59109e-07 1.649726 -9.821908e-05 -2.017344e-06 -0.07079937 0.0005709491 0.0006024689 0.0005345303 6.843328e-05 0.0004427091 0.0004885576 -0.01780154 -0.01835074 -0.01700367 0.9996894 -1.033164e-05 0.008200625 -0.0001520973 -0.0005368337 -0.001328921 -2.353718e-06 -1.600492e-06 -3.147239e-06 2.742565e-06 -1.949341e-06 7.233455e-06 -0.000105876 -0.0001143504 -0.0001021801
   -3.326667e-06 -0.03446059 -0.02179819 1.75443 -0.001827801 -0.006145871 -2.9674e-05 0.0001146328 -9.011834e-05 0.0006570577 -0.002409036 0.001849417 0.001531469 -0.002972741 0.001385087 -6.000291e-06 0.9997352 -0.0001903641 0.008769392 -8.584377e-06 -5.946378e-05 -7.052977e-06 4.714627e-06 1.6233e-06 5.527046e-05 -2.72401e-05 -2.762029e-05 2.921265e-05 -1.814476e-05 -1.224163e-05
   0.002025183 -3.057576e-05 -2.462103 -0.002428571 -7.864504e-05 -0.006380349 -0.0001134667 0.0007756832 -0.0004868109 -0.0006514978 0.0008649816 -0.0001217251 0.0008475379 -0.01291066 0.006836469 1.000194e-05 -1.251892e-06 0.9876815 -4.017491e-05 -5.400155e-05 -0.0001246203 -3.103256e-07 3.014606e-06 -3.298005e-06 -9.688484e-07 -3.812903e-06 5.569852e-06 5.789973e-06 -7.703646e-05 3.92133e-05
   -8.078047e-07 0.002152659 -0.002531794 -2.669877 -0.0002536795 0.4856438 -7.245106e-05 3.431416e-05 4.066352e-05 -1.272096e-06 -0.000323934 0.0002718521 0.001248544 -0.0006824169 -0.0006175719 3.184916e-07 1.42822e-05 -6.042932e-06 0.9866495 1.904539e-05 0.005438216 -1.118646e-06 7.137173e-07 3.766579e-07 6.705139e-06 -3.548749e-06 -3.36346e-06 9.647447e-06 -3.96578e-06 -5.958317e-06
   -1.033244e-06 1.068003e-06 -5.212195e-05 0.01233118 1.902551e-06 1.358311 3.364706e-06 2.837852e-06 2.81928e-06 -6.127646e-05 -5.84792e-05 -6.301974e-05 -4.861998e-05 -3.844331e-05 -3.928157e-05 -2.548563e-07 2.390987e-08 -6.543882e-07 5.439565e-05 0.9967651 0.01519044 6.072523e-08 4.270633e-08 5.139301e-08 -2.879464e-07 -2.166244e-07 -2.148041e-07 -1.35549e-07 -7.375873e-08 -5.603577e-08
   -0.0001510219 6.461754e-05 -0.009297936 0.7097143 0.000115522 -2.849167 0.0004598016 0.0004328321 0.0004267915 -0.008937596 -0.008757642 -0.009040453 -0.006523745 -0.005996675 -0.005964872 -3.780559e-05 1.908776e-06 -0.0001185526 0.003574702 0.003245874 0.9681523 8.856643e-06 7.320967e-06 8.338454e-06 -5.134224e-05 -4.746443e-05 -4.756679e-05 -2.481637e-05 -2.220966e-05 -2.02555e-05
   0.0476064 -0.004139624 -9.250053 -5.14935 -0.01323477 22.59749 -0.1670707 -0.005202217 -0.008986814 0.1873867 0.1430744 0.1431157 -1.356528 0.07681111 0.1361273 -0.03478134 -0.002342347 -0.1227821 0.06692768 0.2171402 0.4698135 0.9764299 -0.0002172219 -8.042117e-06 -0.006571793 0.00176686 -0.0002331941 -0.01161442 0.0005171029 0.0003247651
   0.05866587 0.01141674 54.40491 2.421743 0.02970574 21.33505 -0.005812114 -0.183217 0.003175964 0.1577994 0.1674595 0.1427254 0.1273175 -1.011055 -0.01688205 -0.06702961 0.007580733 -0.2520716 0.04854652 0.187612 0.4256154 -9.181676e-05 0.9753012 -0.0002751785 -0.0003284367 -0.006238297 0.001682617 0.0002333277 -0.009444577 1.754268e-05
   0.04273528 -0.007711592 -35.38396 2.917199 -0.01849701 20.89047 -0.00867405 0.003854182 -0.1750256 0.1328323 0.1542614 0.1870039 0.1133592 -0.08025363 -1.281282 -0.001550744 0.006862628 0.2488323 0.05959999 0.2116171 0.445162 -0.0002121752 0.0001025548 0.9759519 0.001831015 -0.0003289552 -0.00652993 0.0007308535 -0.0009550104 -0.01117902
   0.0005700689 0.01827566 -12.22176 -0.008337302 0.04339304 -116.988 0.04515677 0.04202224 0.03569592 -1.155533 -0.7678939 -0.7775978 -0.1090625 -0.5974949 -0.4988485 -0.004444027 0.001404472 -0.1166384 0.0113838 0.04137918 -1.266522 0.003109019 0.0006820874 0.0007088227 0.9937172 -0.004342123 -0.004123766 0.0009835731 -0.002403132 -0.001701477
   0.0140193 -0.06754413 16.49798 -6.240313 -0.1595567 -115.1092 0.03806055 0.03951562 0.04109858 -0.769439 -1.160539 -0.770636 -0.5123685 -0.009392567 -0.5644844 0.00160526 0.0006913501 0.1216684 -0.02017685 0.04112895 -1.243774 0.0007151601 0.002770156 0.0007868566 -0.003978798 0.9936378 -0.004450785 -0.00167611 0.001637713 -0.002179168
   0.01303104 0.05111328 -2.5766 5.162296 0.1206866 -118.0873 0.03801289 0.03813911 0.04502558 -0.7770999 -0.7685662 -1.157861 -0.5281925 -0.5266727 -0.09806257 -0.0006944909 0.0004550806 -0.01148585 0.0424731 0.04356422 -1.278011 0.0007530618 0.0006384027 0.003051707 -0.004400844 -0.004109048 0.9937377 -0.001895209 -0.001930493 0.001134044
   -0.05480388 0.004943651 1.681355 2.642239 0.01105936 -9.341631 -0.02044439 0.003877663 0.0034532 -0.01023703 -0.0559386 -0.05782061 -2.481141 -0.06866276 -0.0620079 0.008854051 -0.001014861 0.09622948 0.01506241 0.015842 -0.08880176 -0.004341526 3.417817e-05 6.306142e-05 -0.00106959 -0.0002035708 -0.0004047245 0.9780558 -0.0002990083 -0.0002985722
   -0.05959105 -0.009229357 -27.36242 -1.457263 -0.02177579 -8.621651 0.002656123 -0.009007394 -0.002080461 -0.0656875 0.000924209 -0.05756161 -0.0682811 -2.651107 0.007795658 0.001611546 0.001531658 -0.161079 0.00572526 0.01805813 -0.0781733 4.438269e-05 -0.004369077 -1.248491e-05 -0.000391579 -0.001087007 -0.0001527171 -0.0003141422 0.976318 0.0001359692
   -0.05064623 0.004057764 14.45956 -1.296628 0.009664475 -8.52207 0.003998114 -0.0005432179 -0.01876218 -0.05444805 -0.06164946 -0.009023134 -0.06214516 0.008032473 -2.509918 0.0003800462 0.0005782414 0.02953293 -0.005327463 0.02038287 -0.07511068 4.705998e-05 4.802721e-05 -0.004316107 -0.0002108831 -0.0003935055 -0.001082279 -0.0002515904 0.0001075322 0.9774434],
  b=[1.484726e-07 6.957445e-06 -2.381628e-06 -5.377918e-06 -1.356319e-13
   1.516293e-09 -1.135518e-06 2.370548e-06 -2.11023e-06 -4.318693e-14
   1.361594e-08 -2.92384e-07 -2.579826e-06 2.847258e-06 -8.576151e-15
   4.146221e-10 -6.906224e-07 2.778404e-07 -6.342923e-07 3.222445e-12
   5.737055e-10 5.049917e-08 3.840562e-08 4.908777e-08 -6.143491e-10
   1.364354e-07 1.139949e-05 9.381446e-06 1.105921e-05 6.108702e-10
   0.0001288552 -0.00247597 -0.0001554188 -0.0001595748 4.785819e-11
   0.0001357091 -0.0001893717 -0.001817527 -0.0002224816 3.792792e-11
   0.0001341168 -0.0001821473 -0.0001864947 -0.001858724 3.749552e-11
   2.629589e-06 0.001034868 0.0008113906 0.0009550548 -2.240856e-10
   5.104574e-06 0.0009594793 0.0010917 0.000917188 -2.109662e-10
   3.741991e-06 0.0009692075 0.0008205683 0.001358721 -2.324605e-10
   -1.381723e-05 0.0004740692 5.680146e-05 6.43609e-05 -2.050862e-11
   -1.597569e-05 8.391141e-05 -0.0001704332 9.300357e-05 -1.478929e-11
   -1.582779e-05 8.111045e-05 7.265864e-05 -0.0003585628 -1.536517e-11
   3.727772e-05 0.001736307 -0.000596114 -0.001342516 -5.430394e-11
   3.757762e-07 -0.0002828193 0.0005922254 -0.0005281599 -1.130781e-11
   3.415188e-06 -7.296111e-05 -0.0006432043 0.000709772 -3.974672e-12
   1.351167e-07 -0.0001693651 7.14034e-05 -0.0001556584 9.437811e-10
   2.308163e-07 1.989625e-05 1.558893e-05 1.932782e-05 -1.531133e-07
   3.408372e-05 0.002826653 0.002326589 0.002742593 1.51815e-07
   0.03209313 -0.616777 -0.03866273 -0.03976614 1.846413e-08
   0.03379134 -0.04717481 -0.4524595 -0.05538041 1.560507e-08
   0.03340256 -0.04535003 -0.04649503 -0.4627117 1.538653e-08
   0.000674765 0.2571613 0.2017401 0.2374403 -8.967967e-08
   0.001292136 0.2385221 0.2715928 0.2280144 -8.581186e-08
   0.000952478 0.2409254 0.2040184 0.3381093 -9.212193e-08
   -0.003464928 0.1184191 0.01406793 0.0159514 -7.81836e-09
   -0.004003722 0.02081581 -0.04218577 0.02307382 -6.176039e-09
   -0.003966544 0.02011804 0.01802828 -0.0890807 -6.300877e-09],
  c=[0 0 0 0 0 0 0 0 0 0 0 0 0 0 0 0 0 0 0 0 0 0 0 0 0 0 0 0 0 0
   0 0 0 0 0 0 0 0 0 0 0 0 0 0 0 0 0 0 0 0 0 0 0 0 0 0 0 0 0 0
   0 0 0 0 0 0 0 0 0 0 0 0 0 0 0 0 0 0 0 0 0 0 0 0 0 0 0 0 0 0
   0 0 0 0 0 0 0.9923 0 0 0.1686 0 0 1.057 0 0 0 0 0 0 0 0 0 0 0 0 0 0 0 0 0
   0 0 0 0 0 0 0 0.9923 0 0 0.1686 0 0 1.057 0 0 0 0 0 0 0 0 0 0 0 0 0 0 0 0
   0 0 0 0 0 0 0 0 0.9923 0 0 0.1686 0 0 1.057 0 0 0 0 0 0 0 0 0 0 0 0 0 0 0
   0 0 0 0 0 0 -0.1239 0 0 0.9866 0 0 0.1545 0 0 0 0 0 0 0 0 0 0 0 0 0 0 0 0 0
   0 0 0 0 0 0 0 -0.1239 0 0 0.9866 0 0 0.1545 0 0 0 0 0 0 0 0 0 0 0 0 0 0 0 0
   0 0 0 0 0 0 0 0 -0.1239 0 0 0.9866 0 0 0.1545 0 0 0 0 0 0 0 0 0 0 0 0 0 0 0
   -4.256 -0.006167 -266.9 -0.4867 -0.01602 -10.7 0.05164 0.2291 -0.02591 -0.1194 0.2248 0.03852 -2.151 -4.922 -0.8733 -0.02115 -0.001528 -0.2717 -0.02533 -0.07925 -0.1558 -0.0005976 -0.0005857 -0.0009698 0.0006333 -0.001913 0.001859 -0.004054 -0.01033 -0.002131
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   ],
  d=[1 0 0 0 0
   0 0 0 0 0
   0 0 0 0 0
   0 0.363 0 0 0
   0 0 -0.2078 0 0
   0 0 0 -0.4306 0
   0 -0.8479 0 0 0
   0 0 -0.9171 0 0
   0 0 0 -1.064 0
   0.005443 0.2112 -0.2028 -0.03535 1.763e-10
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   ],
  StateName="ED 1st tower fore-aft bending mode DOF (internal DOF index = DOF_TFA1), m"; "ED 1st tower side-to-side bending mode DOF (internal DOF index = DOF_TSS1), m"; "ED 2nd tower fore-aft bending mode DOF (internal DOF index = DOF_TFA2), m"; "ED 2nd tower side-to-side bending mode DOF (internal DOF index = DOF_TSS2), m"; "ED Variable speed generator DOF (internal DOF index = DOF_GeAz), rad"; "ED Drivetrain rotational-flexibility DOF (internal DOF index = DOF_DrTr), rad"; "ED 1st flapwise bending-mode DOF of blade 1 (internal DOF index = DOF_BF(1,1)), m"; "ED 1st flapwise bending-mode DOF of blade 2 (internal DOF index = DOF_BF(2,1)), m"; "ED 1st flapwise bending-mode DOF of blade 3 (internal DOF index = DOF_BF(3,1)), m"; "ED 1st edgewise bending-mode DOF of blade 1 (internal DOF index = DOF_BE(1,1)), m"; "ED 1st edgewise bending-mode DOF of blade 2 (internal DOF index = DOF_BE(2,1)), m"; "ED 1st edgewise bending-mode DOF of blade 3 (internal DOF index = DOF_BE(3,1)), m"; "ED 2nd flapwise bending-mode DOF of blade 1 (internal DOF index = DOF_BF(1,2)), m"; "ED 2nd flapwise bending-mode DOF of blade 2 (internal DOF index = DOF_BF(2,2)), m"; "ED 2nd flapwise bending-mode DOF of blade 3 (internal DOF index = DOF_BF(3,2)), m"; "ED First time derivative of 1st tower fore-aft bending mode DOF (internal DOF index = DOF_TFA1), m/s"; "ED First time derivative of 1st tower side-to-side bending mode DOF (internal DOF index = DOF_TSS1), m/s"; "ED First time derivative of 2nd tower fore-aft bending mode DOF (internal DOF index = DOF_TFA2), m/s"; "ED First time derivative of 2nd tower side-to-side bending mode DOF (internal DOF index = DOF_TSS2), m/s"; "ED First time derivative of Variable speed generator DOF (internal DOF index = DOF_GeAz), rad/s"; "ED First time derivative of Drivetrain rotational-flexibility DOF (internal DOF index = DOF_DrTr), rad/s"; "ED First time derivative of 1st flapwise bending-mode DOF of blade 1 (internal DOF index = DOF_BF(1,1)), m/s"; "ED First time derivative of 1st flapwise bending-mode DOF of blade 2 (internal DOF index = DOF_BF(2,1)), m/s"; "ED First time derivative of 1st flapwise bending-mode DOF of blade 3 (internal DOF index = DOF_BF(3,1)), m/s"; "ED First time derivative of 1st edgewise bending-mode DOF of blade 1 (internal DOF index = DOF_BE(1,1)), m/s"; "ED First time derivative of 1st edgewise bending-mode DOF of blade 2 (internal DOF index = DOF_BE(2,1)), m/s"; "ED First time derivative of 1st edgewise bending-mode DOF of blade 3 (internal DOF index = DOF_BE(3,1)), m/s"; "ED First time derivative of 2nd flapwise bending-mode DOF of blade 1 (internal DOF index = DOF_BF(1,2)), m/s"; "ED First time derivative of 2nd flapwise bending-mode DOF of blade 2 (internal DOF index = DOF_BF(2,2)), m/s"; "ED First time derivative of 2nd flapwise bending-mode DOF of blade 3 (internal DOF index = DOF_BF(3,2)), m/s",
  Delay=struct(Input=repmat(0, 5, 1), Output=repmat(0, 39, 1), Internal=[]),
  Ts=0.008,
  InputName="IfW Extended input: horizontal wind speed (steady/uniform wind), m/s"; "ED Blade 1 pitch command, rad"; "ED Blade 2 pitch command, rad"; "ED Blade 3 pitch command, rad"; "ED Generator torque, Nm",
  OutputName="IfW Wind1VelX, (m/s)"; "IfW Wind1VelY, (m/s)"; "IfW Wind1VelZ, (m/s)"; "SrvD GenPwr, (kW)"; "SrvD GenTq, (kN·m)"; "ED OoPDefl1, (m)"; "ED OoPDefl2, (m)"; "ED OoPDefl3, (m)"; "ED IPDefl1, (m)"; "ED IPDefl2, (m)"; "ED IPDefl3, (m)"; "ED NcIMUTAxs, (m/s^2)"; "ED NcIMUTAys, (m/s^2)"; "ED NcIMUTAzs, (m/s^2)"; "ED RootMOoP1, (kN·m)"; "ED RootMOoP2, (kN·m)"; "ED RootMOoP3, (kN·m)"; "ED RootMIP1, (kN·m)"; "ED RootMIP2, (kN·m)"; "ED RootMIP3, (kN·m)"; "ED RootMFlp1, (kN·m)"; "ED RootMFlp2, (kN·m)"; "ED RootMFlp3, (kN·m)"; "ED RootMEdg1, (kN·m)"; "ED RootMEdg2, (kN·m)"; "ED RootMEdg3, (kN·m)"; "ED TwrBsMxt, (kN·m)"; "ED TwrBsMyt, (kN·m)"; "ED TwrBsMzt, (kN·m)"; "ED LSSTipMya, (kN·m)"; "ED LSSTipMza, (kN·m)"; "ED LSSTipVxa, (rpm)"; "ED GenSpeed, (rpm)"; "ED BlPitch1, (deg)"; "ED Azimuth, (deg)"; "ED RotPwr, (kW)"; "ED RotThrust, (kN)"; "ED RotSpeed, (rpm)"; "ED HSShftTq, (kN·m)")

uoff = reshape([4 0.00185 0.00185 0.00185 5084 5 0.00185 0.00185 0.00185 7941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], 5, 1, 22)
x0 = [0.04089; 0.006898; -0.0002003; 0.0001115; 2.874; 0.0005691; 0.7722; 0.9567; 1.153; 0.4645; -0.08802; -0.2871; 0.003351; -0.01636; -0.02975; -1.797e-5; 0.003571; -2.808e-7; 3.171e-6; 0.4813; 1.791e-6; -0.05546; 0.1083; -0.05252; 0.05736; -0.2114; 0.1538; 0.003753; -0.009248; 0.005485]
xoff = reshape([0.04089 0.006898 -0.0002003 0.0001115 2.874 0.0005691 0.7722 0.9567 1.153 0.4645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], 30, 1, 22)
yoff = reshape([4 0 0 0.8481 0.9173 1.064 0.3631 -0.2079 -0.4306 0.0001462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], 39, 1, 22)
Drivetrain = struct(Generator=struct(Efficiency=0.944, HSSInertia=534.116), Gearbox=struct(Ratio=97, Efficiency=1))

slBus1 = Simulink.Bus()
  wind_mpers: double
  GenSpd_radpers: double
  RotSpd_radpers: double
  ydotdot_mpers2: double
  xdotdot_mpers2: double
  zetadotdot_mpers2: double
  ThetaS_rad: double
  GenPwr_kW: double
  GenTq_Nm: double
  Pitch_rad: double

slBus2 = Simulink.Bus()
  RefBlPitch1: double
  RefBlPitch2: double
  RefBlPitch3: double
  RefGenTq: double