% Simulink data dictionary DD_Mdl.sldd

BEMTPitchMax_deg = -30
BladeLength_m = 61.5
BladeMass_kg = 17740
BladePitchMax_deg = 0
BladePitchStart_deg = -85
BladePitchrateNorm_degpers = 3
BladePitchrateStop_degpers = 9
BladePrecone_deg = 2.5
BladeTwist_deg = [13.308 13.308 13.308 13.308 13.308 13.308 13.308 13.308 13.308 13.308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 0]
Cut_OffWindSpeed_mpers = 25
DownwashCorrection = 0.26
DownwashModelSwitch = 3
GeneratorEfficiency = 0.944
HubRadius_m = 1.5
Overhang_m = 5
RatedOmega_RPM = 12.1
RatedWindSpeed_mpers = 11.4
Shafttilt_deg = 5
TipSpeedLoss = 0
TowerDamOnperoff = 0
TowerDragCoefficient = 0.35
TowerRadius_m = 1.935
cperR = [0.054; 0.054; 0.056; 0.058; 0.06; 0.061; 0.063; 0.065; 0.067; 0.069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 0.017]
drperR = [0.024 0.003 0.016 0.016 0.016 0.016 0.016 0.016 0.016 0.016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 0.005]
g_mpers_2 = 9.81
mpermBl = [0.058 0.008 0.044 0.043 0.042 0.034 0.026 0.024 0.023 0.022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 0]
nBl = 3
nR = 49
rho_kgperm3 = 1.225
rperR = [0.024 0.027 0.043 0.059 0.075 0.09 0.106 0.122 0.138 0.154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 1]
DT_s = 0.008
DT = 0.008
Drivetrain = struct(Generator=struct(Efficiency=0.944, HSSInertia=534.116), Gearbox=struct(Ratio=97, Efficiency=1))
Ng = 97
lambdaCt = [0; 0.1; 0.2; 0.3; 0.4; 0.5; 0.6; 0.7; 0.8; 0.9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 14.9]
pitchCt = [-0.1396263; -0.1361357; -0.132645; -0.1291544; -0.1256637; -0.122173; -0.1186824; -0.1151917; -0.1117011; -0.1082104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 0.4363323]

Ce = [15620.12 0 0 0 0
 0 2215700 0 0 0
 0 0 15620.12 0 0
 0 0 0 6215000 -6215000
 0 0 0 -6215000 6215000]

Cq = [0 0 0 0 0 0 0 0 0 0 -0.0003675471 0 0 0 0 0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
 0 0 0 0 0 0 0 0 0 0 -0.0002177588 0 0 0 0 0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
 0 0 0 0 0 0 0 0 0 0 -6.828258e-05 0 0 0 0 0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
 0 0 0 0 0 0 0 0 0 0 8.122033e-05 2.762054e-05 0 0 0 0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
 0 0 0 0 0 0 0 0 0 0 0.000230825 0.0001845015 0.0001321707 7.652833e-05 1.330544e-05 0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
 0 0 0 0 0 0 0 0 0 0 0.0003802118 0.0003413066 0.0002965678 0.0002487448 0.0001943676 0.0001388959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
 0 0 0 0 0 0 0 0 0 0 0.0005292222 0.000497829 0.0004607288 0.0004210637 0.0003753779 0.0003288786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
 0 0 0 0 0 0 0 0 0 0 0.000678224 0.0006540123 0.0006247619 0.000593107 0.0005555253 0.0005191681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
 0 0 0 0 0 0 0 0 0 0 0.0008272807 0.0008098148 0.0007882221 0.0007646769 0.0007356432 0.0007084813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
 0 0 0 0 0 0 0 0 0 0 0.000975951 0.0009655373 0.000951538 0.0009353435 0.0009152725 0.0008967443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 ]

Ct = [0 0 0 0 0 0 0 0 0 0 0.08432783 0.08783378 0 0 0 0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
 0 0 0 0 0 0 0 0 0 0 0.08433421 0.0878264 0 0 0 0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
 0 0 0 0 0 0 0 0 0 0 0.08433632 0.08781786 0 0 0 0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
 0 0 0 0 0 0 0 0 0 0 0.08433706 0.08780611 0.09155931 0 0 0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
 0 0 0 0 0 0 0 0 0 0 0.08433584 0.08779221 0.09153404 0.09540476 0.09937986 0.1035862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
 0 0 0 0 0 0 0 0 0 0 0.08433138 0.08777684 0.09150628 0.09535641 0.09931453 0.1035048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
 0 0 0 0 0 0 0 0 0 0 0.08432582 0.08776037 0.09147642 0.09530743 0.09924897 0.1033939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
 0 0 0 0 0 0 0 0 0 0 0.08431997 0.08774197 0.09144539 0.0952569 0.09915284 0.103335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
 0 0 0 0 0 0 0 0 0 0 0.08431232 0.08771952 0.09140989 0.09520266 0.09908266 0.1032188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
 0 0 0 0 0 0 0 0 0 0 0.08430095 0.08769711 0.09137293 0.09514412 0.09900934 0.1031278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 ]

K = [1589935 0 0 0
 0 1.01949e+09 0 0
 0 0 1589935 0
 0 0 0 867637000
 0 0 0 -867637000]

L = [1 0 0 0 0
 0 1 0 0 0
 0 0 1 0 0
 0 0 0 1 -1]

M = [396950 838215 0 0 0
 838215 52807545 0 0 0
 0 0 383645 0 0
 0 0 0 35443926 0
 0 0 0 0 5025497.444]

Q = [1 0 0 0
 63 0 0 0
 0 1 0 0
 0 0 1 0
 0 0 0 -97]

lambda = [0; 0.1; 0.2; 0.3; 0.4; 0.5; 0.6; 0.7; 0.8; 0.9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 14.9]
pitch = [-0.1396263; -0.1361357; -0.132645; -0.1291544; -0.1256637; -0.122173; -0.1186824; -0.1151917; -0.1117011; -0.1082104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 0.4363323]
rho = 1.225
tau = 0.1

wecs = struct(
  N=3,
  Ng=97,
  mh=56780,
  mbl=17740,
  mb=4435,
  mn=240000,
  mtower=347460,
  mr=110000,
  mt=436865,
  mtb=450170,
  H=90,
  Jg=534.116,
  Jr=38759000,
  wnb=4.393831,
  wnt=2.035752,
  wntsw=1.960354,
  zetat=0.01,
  zetab=0.00477465,
  Kt=1810494,
  Bt=17786.98,
  Ktsw=1678867,
  Btsw=17128.2,
  Kb=85621.02,
  Bb=186.0838,
  Ks=867637000,
  Bs=6215000,
  Rr=63,
  rb=47.25,
  etag=0.944)

kappa = 0.01